# Grasshopper definition LampGenerator.gh (Grasshopper 1.0.7)

# curve to extrusion
pt = ConstructPoint(XCoordinate=0, YCoordinate=0, ZCoordinate=0)
panel = Panel("""True
True
False
False""")
not = GateNot(A=panel)

number_of_creases = Slider(36, range=0..200)
destance_b_layers = Slider(12, range=0..100)
depth_of_crease = Slider(10, range=-50..50)
rotation = Slider(0, range=0..12)
height = Slider(10, range=0..100)
crv = Curve(<curve referenced from the Rhino model>)
# morph from curve to basement
# basement options
number_slider = Slider(0, range=0..0.1)
neg = Negative(Value=depth_of_crease)
series = Series(Start=number_slider, Step=0.1, Count=height)
graph = GraphMapper(
    series,
    x0=0,
    x1=1,
    y0=0,
    y1=1,
    container_name="Sine",
    Equation_px=[0, 0.1538348645],
    Equation_py=[0.8179617524, 0.9638381004])
series_2 = Series(Start=0, Step=destance_b_layers, Count=height)
Z = UnitZ(Factor=series_2)
series_3 = Series(Start=0, Step=rotation, Count=height)
rad = Radians(Degrees=series_3)
X = UnitX(Factor=Slider(0, range=0..100))

divide = DivideCurve(Curve=crv, Count=number_of_creases, Kinks=False)  # -> Points, Tangents, Parameters
dispatch = Dispatch(List=divide.Points, DispatchPattern=panel)  # -> ListA, ListB
vec2pt = Vector2Pt(PointA=pt, PointB=dispatch.ListB, Unitize=False)  # -> Vector, Length
pt_2 = Point(dispatch.ListA)
amp = Amplitude(Vector=vec2pt.Vector, Amplitude=neg)
move = Move(Geometry=dispatch.ListB, Motion=amp)  # -> Geometry, Transform
weave = Weave(Pattern=not, Stream0=pt_2, Stream1=move.Geometry, NullGaps=False)
intcrv = Interpolate(Vertices=weave, Degree=3, Periodic=True, KnotStyle=1)  # -> Curve, Length, Domain

move_2 = Move(Geometry=intcrv.Curve, Motion=Z)  # -> Geometry, Transform
area = Area(Geometry=move_2.Geometry)  # -> Area, Centroid
scale = Scale(Geometry=move_2.Geometry, Center=area.Centroid, Factor=graph)  # -> Geometry, Transform
rotate = Rotate(Geometry=scale.Geometry, Angle=rad, Plane=PlaneXY(0, 0, 0))  # -> Geometry, Transform
loft = Loft(Curves=rotate.Geometry, Options={Adjust=False, Closed=False, LoftEnds=0, LoftSimp=0, LoftType=0, Rebuild=10, Refit=0.01})
cap = CapHoles(Brep=loft)
move_3 = Move(Geometry=cap, Motion=X)  # -> Geometry, Transform
preview = CustomPreview(Geometry=move_3.Geometry, Material=ColourSwatch(SwatchColor=RGB(255, 97, 250)))
